# Grasshopper definition ImageRegionSelector.gh (Grasshopper 0.9.76)
# plug-ins: Python Interpreter

ladybug = Ladybug_Ladybug()  # -> Vviiiiiiiiiizzz; plug-in component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
rectangle = Rectangle(Plane=PlaneXY(0, 0, 0), XSize="100", YSize="100", Radius=0)  # -> Rectangle, Length
mplane = MeshPlane(Boundary=rectangle.Rectangle, WidthCount="100", HeightCount="100")  # -> Mesh, Area
meshselector = Ladybug_MeshThresholdSelector(operator="<")  # -> readMe, totalValue, areaMeetsThresh, newColoredMesh, newMeshOutline; plug-in component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
